# Grasshopper definition Teams_Msg.gh (Grasshopper 1.0.7)

c_script = CSharpScript(x=Button(), y="Test", Reference="C:\Users\dista\AppData\Roaming\Grasshopper\Libraries\Newtonsoft.Json.dll")  # -> out, A; inputs x: Boolean, y: String
# ---------- c_script: C# usings ----------
using Newtonsoft.Json;
using System.Net.Http;
using System.Text;
using System.Runtime;
# ---------- c_script: C# ----------
  //https://learn.microsoft.com/en-us/nuget/quickstart/install-and-use-a-package-in-visual-studio

  //This C# application will wait till a true boolean input occurs
  //If true, a Microsoft Teams message will be sent to team via webhookUrl


  if(x == true){
  //

  string webhookUrl = "https://webhook.url";


  string message = y.ToString();

  // Create the HttpClient

  HttpClient client = new HttpClient();

  // Build the request body

  var requestBody = new
  {
  text = message
  };

  // Serialize the request body to a JSON string

  string jsonBody = JsonConvert.SerializeObject(requestBody);
  StringContent content = new StringContent(jsonBody, Encoding.UTF8, "application/json");

  // Send the request to the webhook URL

  HttpResponseMessage response = client.PostAsync(webhookUrl, content).Result;

  A="Message Sent";

  }
# ---------- end c_script ----------
panel = Panel(c_script.A)
